# Grasshopper definition 20221003_meshsubd_city_engine.gh (Grasshopper 1.0.7)

panel = Panel("C:\D\GitHub")  # disabled
mesh = Mesh(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)  # disabled
boolean_toggle = BooleanToggle(True)  # disabled
number_slider = Slider(2, range=0..10)  # disabled
mesh_2 = Mesh(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)
mesh_3 = Mesh(<mesh referenced from the Rhino model>)
init_mesh = GhPythonScript(mola_path=panel, toggle=boolean_toggle, seed=number_slider)  # -> out, mola_mesh, rhino_mesh; inputs rhino_mesh: Mesh, seed: Int32; disabled
# ---------- init_mesh: Python ----------
__author__ = "Wen"
__version__ = "2022.10.03"

import sys
import os

if mola_path not in sys.path:
    sys.path.append(mola_path)

import mola
import random
from mola import module_rhino
from mola import Engine
random.seed(seed)

mola_mesh = module_rhino.mesh_from_rhino_mesh(rhino_mesh)

if toggle:
    for f in mola_mesh.faces:
        f.group = "block"

    mola.color_by_group(mola_mesh.faces)
    rhino_mesh = module_rhino.display_mesh(mola_mesh)
# ---------- end init_mesh ----------
add_path = GhPythonScript(mola_path="C:\D\GitHub", toggle=Toggle(True), rhino_mesh=mesh_2)  # -> out, a; inputs rhino_mesh: Mesh, seed: Int32; disabled
# ---------- add_path: Python ----------
__author__ = "Wen"
__version__ = "2022.10.03"

import sys
import os

if mola_path not in sys.path:
    sys.path.append(mola_path)

# find .py file within the same folder of .gh file
ghComp = ghenv.Component
ghDoc = ghComp.OnPingDocument()
gh_file_location = ghDoc.FilePath

parent = os.path.dirname(os.path.realpath(gh_file_location))
file_name = "20221003_meshsubd_city_engine.py"
file_path = os.path.join(parent, file_name)

# execute .py
if toggle:
    execfile(file_path)
# ---------- end add_path ----------
add_path_2 = GhPythonScript(mola_path="C:\D\GitHub", toggle=Toggle(True), rhino_mesh=mesh_3)  # -> out, a; inputs rhino_mesh: Mesh, seed: Int32
# ---------- add_path_2: Python ----------
__author__ = "Wen"
__version__ = "2022.10.03"

import sys
import os

if mola_path not in sys.path:
    sys.path.append(mola_path)

# find .py file within the same folder of .gh file
ghComp = ghenv.Component
ghDoc = ghComp.OnPingDocument()
gh_file_location = ghDoc.FilePath

parent = os.path.dirname(os.path.realpath(gh_file_location))
file_name = "20221003_meshsubd_city_engine_b.py"
file_path = os.path.join(parent, file_name)

# execute .py
if toggle:
    execfile(file_path)
# ---------- end add_path_2 ----------
geo = Geometry(init_mesh.rhino_mesh)  # disabled
subdivide = GhPythonScript(mola_mesh=init_mesh.mola_mesh, seed=number_slider)  # -> out, mola_mesh, rhino_mesh; inputs seed: Int32; disabled
# ---------- subdivide: Python ----------
__author__ = "Wen"
__version__ = "2022.10.03"

import mola
import random
from mola import module_rhino
from mola import Engine
random.seed(seed)

def my_filter(face):
    return face.group == "block"

def my_rule(face):
    return mola.subdivide_face_split_grid(face, 8, 3)

def my_labeling(divided_faces, undivided_faces):
    for faces in divided_faces:
        for f in faces:
            f.group = "block"

mola_mesh.faces = Engine.subdivide(mola_mesh.faces, my_filter, my_rule, my_labeling)


mola.color_by_group(mola_mesh.faces)
rhino_mesh = module_rhino.display_mesh(mola_mesh)
# ---------- end subdivide ----------
geometry = Geometry(add_path.a)
geometry_2 = Geometry(add_path_2.a)
mesh_edges = MeshEdges()  # -> NakedEdges, InteriorEdges, NonManifoldEdges
geo_2 = Geometry(subdivide.rhino_mesh)  # disabled
subdivide_2 = GhPythonScript(mola_mesh=subdivide.mola_mesh, seed=number_slider)  # -> out, mola_mesh, rhino_mesh; inputs seed: Int32; disabled
# ---------- subdivide_2: Python ----------
__author__ = "Wen"
__version__ = "2022.10.03"

import mola
import random
from mola import module_rhino
from mola import Engine
random.seed(seed)

def my_filter(face):
    return face.group == "block"

def my_rule(face):
    return mola.subdivide_face_extrude_tapered(face, 0, 0.2)

def my_labeling(divided_faces, undivided_faces):
    for faces in divided_faces:
        Engine.group_by_index(faces, "road", "up")
    for f in undivided_faces:
        f.group = "road"

mola_mesh.faces = Engine.subdivide(mola_mesh.faces, my_filter, my_rule, my_labeling, 0.8)


mola.color_by_group(mola_mesh.faces)
rhino_mesh = module_rhino.display_mesh(mola_mesh)
# ---------- end subdivide_2 ----------
subdivide_3 = GhPythonScript(mola_mesh=subdivide_2.mola_mesh, seed=number_slider)  # -> out, mola_mesh, rhino_mesh; inputs seed: Int32; disabled
# ---------- subdivide_3: Python ----------
__author__ = "Wen"
__version__ = "2022.10.03"

import mola
import random
from mola import module_rhino
from mola import Engine
random.seed(seed)

def my_filter_up(face):
    return face.group == "up"

def my_rule_up(face):
    return mola.subdivide_face_extrude_tapered(face, 3, 0)

def my_labeling_up(divided_faces, undivided_faces):
    for faces in divided_faces:
        Engine.group_by_orientation(faces, "up", "down", "side")
    for f in undivided_faces:
        f.group = "roof"

def my_filter_side(face):
    return face.group == "side"

def my_rule_side(face):
    return mola.subdivide_face_extrude_tapered(face, 3, 0)

def my_labeling_side(divided_faces, undivided_faces):
    for faces in divided_faces:
        Engine.group_by_orientation(faces, "up", "down", "side")
    for f in undivided_faces:
        f.group = "wall"

for _ in range(20):
    mola_mesh.faces = Engine.subdivide(mola_mesh.faces, my_filter_up, my_rule_up, my_labeling_up, 0.85)
    mola_mesh.faces = Engine.subdivide(mola_mesh.faces, my_filter_side, my_rule_side, my_labeling_side, 0.08)


mola.color_by_group(mola_mesh.faces)
rhino_mesh = module_rhino.display_mesh(mola_mesh)
# ---------- end subdivide_3 ----------
geo_3 = Geometry(subdivide_2.rhino_mesh)  # disabled
subdivide_4 = GhPythonScript(mola_mesh=subdivide_2.mola_mesh, seed=number_slider)  # -> out, mola_mesh, rhino_mesh; inputs seed: Int32; disabled
# ---------- subdivide_4: Python ----------
__author__ = "Wen"
__version__ = "2022.10.03"

import mola
import random
from mola import module_rhino
from mola import Engine
random.seed(seed)

def my_filter(face):
    return face.group == "side"

def my_rule(face):
    return mola.subdivide_face_split_cell(face, 1, 3)

def my_labeling(divided_faces, undivided_faces):
    for faces in divided_faces:
        Engine.group_by_default(faces, "side")
    for f in undivided_faces:
        f.group = "wall"

mola_mesh.faces = Engine.subdivide(mola_mesh.faces, my_filter, my_rule, my_labeling, 0.8)


mola.color_by_group(mola_mesh.faces)
rhino_mesh = module_rhino.display_mesh(mola_mesh)
# ---------- end subdivide_4 ----------
geo_4 = Geometry(subdivide_3.rhino_mesh)  # disabled
subdivide_5 = GhPythonScript(mola_mesh=subdivide_4.mola_mesh, seed=number_slider)  # -> out, mola_mesh, rhino_mesh; inputs seed: Int32; disabled
# ---------- subdivide_5: Python ----------
__author__ = "Wen"
__version__ = "2022.10.03"

import mola
import random
from mola import module_rhino
from mola import Engine
random.seed(seed)

def my_filter(face):
    return face.group == "side"

def my_rule(face):
    return mola.subdivide_face_extrude_tapered(face, 0, 0.3)

def my_labeling(divided_faces, undivided_faces):
    for faces in divided_faces:
        Engine.group_by_index(faces, "frame", "glass")
    for f in undivided_faces:
        f.group = "panel"

mola_mesh.faces = Engine.subdivide(mola_mesh.faces, my_filter, my_rule, my_labeling, 0.8)


mola.color_by_group(mola_mesh.faces)
rhino_mesh = module_rhino.display_mesh(mola_mesh)
# ---------- end subdivide_5 ----------
geo_5 = Geometry(subdivide_4.rhino_mesh)  # disabled
geo_6 = Geometry(subdivide_5.rhino_mesh)  # disabled
