# Grasshopper definition 20221017_workflow_example.gh (Grasshopper 1.0.7)
# plug-ins: Axolotl Info, Pufferfish

# ----
# Brick Wall
number_slider = Slider(5, range=0..10)  # disabled
neg = Negative(Value=number_slider)  # disabled
dom = ConstructDomain(DomainStart=neg, DomainEnd=number_slider)  # disabled
xz = XZPlane(Origin=Point(0, 0, 0))  # disabled
panel = Panel("2")  # disabled
multiplication = Multiplication(A=number_slider, B=panel)  # disabled
rectangle = Rectangle(Plane=xz, XSize=dom, YSize=dom, Radius=0)  # -> Rectangle, Length; disabled
morter = Slider(0.2, range=0..2)  # disabled
number_slider_2 = Slider(8, range=0..10)  # disabled
number_slider_3 = Slider(5, range=0..10)  # disabled
pt = ConstructPoint(XCoordinate=0, YCoordinate=0, ZCoordinate=0)  # disabled
thickness = Slider(1.2, range=0..5)  # disabled
arrrec = RectangularArray(Geometry=pt, Cell=rectangle.Rectangle, XCount=number_slider_2, YCount=number_slider_3)  # -> Geometry, Transform; disabled
subtraction = Subtraction(A=multiplication, B=morter)  # disabled
xz_2 = XZPlane(Origin=arrrec.Geometry)  # disabled
subtraction_2 = Subtraction(A=subtraction, B=thickness)  # disabled
box = Box(DimensionX=subtraction, DimensionY=subtraction, DimensionZ=subtraction, Radius=0, Plane=xz_2)  # disabled
box_2 = Box(DimensionX=subtraction_2, DimensionY=subtraction_2, DimensionZ=subtraction, Radius=0, Plane=xz_2)  # disabled

# ---- group: CSG
# Primitives
X = UnitX(Factor=1)
Y = UnitY(Factor=1)
Z = UnitZ(Factor=1)
number_slider_4 = Slider(9, range=0..10)
pl = PlaneNormal(Origin=Point(0, 0, 0), ZAxis=[X, Y, Z])
box_3 = Box(DimensionX=number_slider_4, DimensionY=number_slider_4, DimensionZ=number_slider_4, Radius=0, Plane=PlaneXY(0, 0, 0))
sphere = Sphere(Radius=Slider(6, range=0..10), Center=Point(0, 0, 0))
cylinder = Cylinder(Radius=Slider(3, range=0..10), Height=Slider(12, range=0..20), Plane=pl, Fillet=0)

# ----
number_slider_5 = Slider(3, range=0..10)  # disabled

# ----
# Random Planes for Edges
number_slider_6 = Slider(9, range=0..10)  # disabled
number_slider_7 = Slider(3.4, range=0..10)  # disabled
sph = Sphere(Base=PlaneXY(0, 0, 0), Radius=number_slider_7)  # disabled
popgeo = PopulateGeometry(Geometry=sph, Count=number_slider_6, Seed=1)  # disabled
pl_2 = PlaneNormal(Origin=popgeo, ZAxis=popgeo)  # disabled

# ----
# Bounding Box
number_slider_8 = Slider(5, range=0..10)  # disabled
neg_2 = Negative(Value=number_slider_8)  # disabled
dom_2 = ConstructDomain(DomainStart=neg_2, DomainEnd=number_slider_8)  # disabled
box_4 = DomainBox(Base=PlaneXY(0, 0, 0), X=dom_2, Y=dom_2, Z=dom_2)  # disabled
edges = BrepEdges(Brep=box_4)  # -> Naked, Interior, NonManifold; disabled

# ---- group: CSG
# Boolean Operators
boolean_intersect = BooleanIntersect(DistanceObjectS=sphere, DistanceObject=box_3)
boolean_union = BooleanUnion(DistanceObjectS=cylinder)
boolean_subtract = BooleanSubtract(DistanceObject=boolean_intersect, DistanceObject_2=boolean_union)

# ----
number_slider_9 = Slider(100, range=0..1000)
# Octree Meshing
isosurface_distancefunction = IsosurfaceDistancefunction(
    NumberX=number_slider_9,
    NumberY=number_slider_9,
    NumberZ=number_slider_9,
    Isovalue=0,
    Capped=False,
    DistanceObject=boolean_subtract,
    Refine=True)
preview = CustomPreview(Geometry=isosurface_distancefunction, Material=ColourSwatch(SwatchColor=RGB(238, 102, 121)))

# ----
# Square edge profiles
# Blended smoothly with a central sphere
dimension_x_y = Slider(1.5, range=0..10)  # disabled
number_slider_10 = Slider(3.5, range=0..10)  # disabled
number_slider_11 = Slider(0.3, range=0..1)  # disabled
number_slider_12 = Slider(2, range=0..10)  # disabled
box_5 = Box(DimensionX=dimension_x_y, DimensionY=dimension_x_y, DimensionZ=number_slider_10, Radius=number_slider_11, Plane=pl_2)  # disabled
number_slider_13 = Slider(10, range=0..10)  # disabled
boolean_union_2 = BooleanUnion(DistanceObjectS=box_5)  # disabled
sphere_2 = Sphere(Radius=number_slider_12, Center=Point(0, 0, 0))  # disabled
smoothunionlist = SmoothUnionList(DistanceObjects=flatten([boolean_union_2, sphere_2]), SmoothingFactor=number_slider_13)  # disabled

number_slider_14 = Slider(35, range=0..100)
number_slider_15 = Slider(300, range=0..1000)
number_slider_16 = Slider(70, range=0..1000)
number_slider_17 = Slider(21, range=0..100)

# ----
# Bounding Box
panel_2 = Panel("5")  # disabled
box_6 = CenterBox(Base=arrrec.Geometry, X=panel_2, Y=panel_2, Z=panel_2)

dense_grid = DenseGrid(
    DistanceObject=boolean_subtract,
    Box={Plane=PlaneXY(0, 0, 0), X=Domain(-5, 5), Y=Domain(-5, 5), Z=Domain(-5, 5)},
    NumberX=number_slider_17,
    NumberY=number_slider_17,
    NumberZ=number_slider_17)  # -> Values, Points

# ----
# Create shell and cut off tips
number_slider_18 = Slider(4.8, range=0..10)  # disabled
number_slider_19 = Slider(0.2, range=0..1)  # disabled
number_slider_20 = Slider(1, range=0..2)  # disabled
shell = Shell(DistanceObject=smoothunionlist, Thickness=number_slider_19, Factor=number_slider_20)  # disabled
sphere_3 = Sphere(Radius=number_slider_18, Center=Point(0, 0, 0))  # disabled
boolean_intersect_2 = BooleanIntersect(DistanceObjectS=sphere_3, DistanceObject=shell)  # disabled

number_slider_21 = Slider(178, range=0..1000)
division = Division(A=number_slider_21, B=2)
Z_2 = UnitZ(Factor=division)
smaller_than = SmallerThan(FirstNumber=dense_grid.Values, SecondNumber=Slider(0, range=0..100))  # -> SmallerThan, OrEqualTo
box_7 = Box(DimensionX=number_slider_16, DimensionY=number_slider_14, DimensionZ=number_slider_15, Radius=0, Plane=PlaneXY(0, 0, 0))
yz = YZPlane(Origin=Z_2)
# Inner Lattices
pt_2 = Point(<point referenced from the Rhino model>)
number_slider_22 = Slider(0.25, range=0..1)
tpms = TPMS(Wavelength=Slider(43, range=0..100))
plane = Plane(Origin=pt_2, Normal=Vector(0, 0, 1))

# ----
# Isosurface Meshing
number_slider_23 = Slider(150, range=0..200)  # disabled
isosurface_distancefunction_2 = IsosurfaceDistancefunction(
    NumberX=number_slider_23,
    NumberY=number_slider_23,
    NumberZ=number_slider_23,
    Isovalue=0,
    Capped=False,
    DistanceObject=boolean_intersect_2,
    Refine=True)  # disabled
swatch = ColourSwatch(SwatchColor=RGB(238, 102, 121))  # disabled
preview_2 = CustomPreview(Geometry=isosurface_distancefunction_2, Material=swatch)  # disabled

cull_pattern = CullPattern(List=dense_grid.Points, CullPattern=smaller_than.SmallerThan)
shell_2 = Shell(DistanceObject=tpms, Thickness=Slider(0.6, range=0..2), Factor=0.5)
division_2 = Division(A=number_slider_16, B=2)
division_3 = Division(A=number_slider_14, B=2)
division_4 = Division(A=number_slider_15, B=2)
box_8 = CenterBox(Base=PlaneXY(0, 0, 0), X=Slider(130, range=0..1000), Y=Slider(47, range=0..100), Z=number_slider_21)
overlay = Overlay(DistanceObject=shell_2, DistanceObject_2=plane, Factor=Slider(0.006, range=0..0.01))
center_box = CenterBox(Base=cull_pattern, X=number_slider_22, Y=number_slider_22, Z=number_slider_22)
mesh_brep = MeshBrep(
    Brep=center_box,
    Settings={GridMaxCount=0, GridMinCount=16, JaggedSeams=False, MaxEdgeLength=0, MinEdgeLength=0.0001, MinTolerance=0, Refine=True, RefineAngle=0, RelativeTolerance=0.65, SimplePlanes=True, Tolerance=0})
list_item = ListItem(List=mesh_brep, Index=0, Wrap=True)
boolean_intersect_3 = BooleanIntersect(DistanceObjectS=box_7, DistanceObject=overlay)

boolean_subtract_2 = BooleanSubtract(DistanceObject=box, DistanceObject_2=box_2)  # disabled
boolean_union_3 = BooleanUnion(DistanceObjectS=graft(boolean_subtract_2), DistanceObject=boolean_intersect_3)  # -> flatten(D); disabled

box_9 = CenterBox(Base=PlaneXY(0, 0, 0), X=division_2, Y=division_3, Z=division_4)

# ----
# Isosurface Meshing
number_slider_24 = Slider(45, range=0..100)
isosurface_distancefunction_3 = IsosurfaceDistancefunction(
    BoundingBox=box_8,
    NumberX=number_slider_24,
    NumberY=number_slider_24,
    NumberZ=number_slider_24,
    Isovalue=0,
    Capped=False,
    DistanceObject=boolean_intersect_3,
    Refine=True)
preview_3 = CustomPreview(Geometry=isosurface_distancefunction_3, Material=ColourSwatch(SwatchColor=RGB(238, 102, 121)))

add_path = GhPythonScript(mola_path="C:\D\GitHub", toggle=Toggle(False), rhino_mesh=list_item)  # -> out, a; inputs rhino_mesh: Mesh, seed: Int32
# ---------- add_path: Python ----------
__author__ = "Wen"
__version__ = "2022.10.03"

import sys
import os

if mola_path not in sys.path:
    sys.path.append(mola_path)

# find .py file within the same folder of .gh file
ghComp = ghenv.Component
ghDoc = ghComp.OnPingDocument()
gh_file_location = ghDoc.FilePath

parent = os.path.dirname(os.path.realpath(gh_file_location))
file_name = "20221017_meshsubd.py"
file_path = os.path.join(parent, file_name)

# execute .py
if toggle:
    execfile(file_path)
# ---------- end add_path ----------
geometry = Geometry(add_path.a)
division_5 = Division(A=Slider(3, range=0..10), B=2)
division_6 = Division(A=division_4, B=division_5)
division_7 = Division(A=division_2, B=division_5)
division_8 = Division(A=division_3, B=division_5)
dense_grid_2 = DenseGrid(DistanceObject=boolean_intersect_3, Box=box_9, NumberX=division_7, NumberY=division_8, NumberZ=division_6)  # -> Values, Points
smaller_than_2 = SmallerThan(FirstNumber=dense_grid_2.Values, SecondNumber=Slider(0, range=0..100))  # -> SmallerThan, OrEqualTo
cull_pattern_2 = CullPattern(List=dense_grid_2.Points, CullPattern=smaller_than_2.SmallerThan)
center_box_2 = CenterBox(Base=cull_pattern_2, X=division_5, Y=division_5, Z=division_5)

# ----
# Inner Lattices
number_slider_25 = Slider(20, range=0..100)
number_slider_26 = Slider(300, range=0..1000)
cylinder_2 = Cylinder(Radius=number_slider_25, Height=Slider(300, range=0..1000), Plane=PlaneXY(0, 0, 0), Fillet=0)
cylinder_3 = Cylinder(Radius=Slider(37, range=0..100), Height=number_slider_26, Plane=PlaneXY(0, 0, 0), Fillet=0)
boolean_subtract_3 = BooleanSubtract(DistanceObject=cylinder_3, DistanceObject_2=cylinder_2)
number_slider_27 = Slider(100, range=0..100)
number_slider_28 = Slider(100, range=0..100)
pt_3 = Point(<point referenced from the Rhino model>)
tpms_2 = TPMS(Wavelength=Slider(45, range=0..100))
division_9 = Division(A=Slider(3, range=0..10), B=2)
division_10 = Division(A=number_slider_27, B=2)
division_11 = Division(A=number_slider_27, B=2)
division_12 = Division(A=number_slider_26, B=2)
plane_2 = Plane(Origin=pt_3, Normal="{0, 0, -1}")
shell_3 = Shell(DistanceObject=tpms_2, Thickness=Slider(0.7, range=0..2), Factor=0.5)
box_10 = CenterBox(Base=PlaneXY(0, 0, 0), X=number_slider_28, Y=number_slider_28, Z=Slider(200, range=0..1000))
overlay_2 = Overlay(DistanceObject=shell_3, DistanceObject_2=plane_2, Factor=Slider(0.003, range=0..0.01))
division_13 = Division(A=division_12, B=division_9)
division_14 = Division(A=division_10, B=division_9)
division_15 = Division(A=division_11, B=division_9)
box_11 = CenterBox(Base=PlaneXY(0, 0, 0), X=division_10, Y=division_11, Z=division_12)
boolean_intersect_4 = BooleanIntersect(DistanceObjectS=boolean_subtract_3, DistanceObject=overlay_2)
dense_grid_3 = DenseGrid(DistanceObject=boolean_intersect_4, Box=box_11, NumberX=division_14, NumberY=division_15, NumberZ=division_13)  # -> Values, Points
smaller_than_3 = SmallerThan(FirstNumber=dense_grid_3.Values, SecondNumber=Slider(0, range=0..100))  # -> SmallerThan, OrEqualTo
cull_pattern_3 = CullPattern(List=dense_grid_3.Points, CullPattern=smaller_than_3.SmallerThan)
center_box_3 = CenterBox(Base=cull_pattern_3, X=division_9, Y=division_9, Z=division_9)
mesh_brep_2 = MeshBrep(
    Brep=center_box_3,
    Settings={GridMaxCount=0, GridMinCount=16, JaggedSeams=False, MaxEdgeLength=0, MinEdgeLength=0.0001, MinTolerance=0, Refine=True, RefineAngle=0, RelativeTolerance=0.65, SimplePlanes=True, Tolerance=0})
mjoin = MeshJoin(Meshes=mesh_brep_2)
list_item_2 = ListItem(List=mesh_brep_2, Index=0, Wrap=True)
add_path_2 = GhPythonScript(
    mola_path="C:\D\GitHub",
    toggle=Toggle(False),
    rhino_mesh=mjoin,
    dist_in=Slider(20.83, range=0..100),
    dist_out=Slider(35.77, range=0..100))  # -> out, a; inputs rhino_mesh: Mesh, seed: Int32; same code as add_path
panel_3 = Panel(add_path_2.out)
geometry_2 = Geometry(add_path_2.a)

pt_4 = Point(<point referenced from the Rhino model>)
pt_5 = Point(<point referenced from the Rhino model>)
pt_6 = Point(<point referenced from the Rhino model>)
box_12 = Box(
    DimensionX=Slider(200, range=0..1000),
    DimensionY=Slider(100, range=0..100),
    DimensionZ=Slider(100, range=0..100),
    Radius=0,
    Plane=PlaneXY(0, 0, 0))
sphere_4 = Sphere(Radius=Slider(80, range=0..100), Center=pt_4)
sphere_5 = Sphere(Radius=Slider(60, range=0..100), Center=pt_5)
sphere_6 = Sphere(Radius=Slider(100, range=0..100), Center=pt_6)
number_slider_29 = Slider(220, range=0..300)
boolean_union_4 = BooleanUnion(DistanceObjectS=sphere_4, DistanceObject=sphere_5)
pt_7 = Point(<point referenced from the Rhino model>)
boolean_union_5 = BooleanUnion(DistanceObjectS=boolean_union_4, DistanceObject=sphere_6)
boolean_subtract_4 = BooleanSubtract(DistanceObject=box_12, DistanceObject_2=boolean_union_5)
division_16 = Division(A=Slider(200, range=0..1000), B=2)
division_17 = Division(A=Slider(100, range=0..100), B=2)
division_18 = Division(A=Slider(100, range=0..100), B=2)
division_19 = Division(A=Slider(4, range=0..10), B=2)
neg_3 = Negative(Value=Slider(10, range=0..10))
box_13 = CenterBox(Base=pt_7, X=number_slider_29, Y=number_slider_29, Z=Slider(100, range=0..1000))
pt_8 = ConstructPoint(XCoordinate=0, YCoordinate=0, ZCoordinate=neg_3)
division_20 = Division(A=division_18, B=division_19)
division_21 = Division(A=division_16, B=division_19)
division_22 = Division(A=division_17, B=division_19)
box_14 = CenterBox(Base=pt_8, X=division_16, Y=division_17, Z=division_18)
boolean_intersect_5 = BooleanIntersect(DistanceObjectS=boolean_subtract_4)
addition = Addition(A=division_21, B=1)
addition_2 = Addition(A=division_22, B=1)
addition_3 = Addition(A=division_20, B=1)

# ----
# Isosurface Meshing
number_slider_30 = Slider(45, range=0..100)
isosurface_distancefunction_4 = IsosurfaceDistancefunction(
    BoundingBox=box_10,
    NumberX=number_slider_30,
    NumberY=number_slider_30,
    NumberZ=number_slider_30,
    Isovalue=0,
    Capped=False,
    DistanceObject=boolean_intersect_4,
    Refine=True)
preview_4 = CustomPreview(Geometry=isosurface_distancefunction_4, Material=ColourSwatch(SwatchColor=RGB(238, 102, 121)))

# ----
# Isosurface Meshing
number_slider_31 = Slider(80, range=0..100)
isosurface_distancefunction_5 = IsosurfaceDistancefunction(
    BoundingBox=box_13,
    NumberX=number_slider_31,
    NumberY=number_slider_31,
    NumberZ=number_slider_31,
    Isovalue=0,
    Capped=False,
    DistanceObject=boolean_subtract_4,
    Refine=True)
preview_5 = CustomPreview(Geometry=isosurface_distancefunction_5, Material=ColourSwatch(SwatchColor=RGB(238, 102, 121)))

number_slider_32 = Slider(0, range=0..100)
dense_grid_4 = DenseGrid(DistanceObject=boolean_intersect_5, Box=box_14, NumberX=addition, NumberY=addition_2, NumberZ=addition_3)  # -> Values, Points
smaller_than_4 = SmallerThan(FirstNumber=dense_grid_4.Values, SecondNumber=number_slider_32)  # -> SmallerThan, OrEqualTo
equalst = EqualityWithinTolerance(FirstNumber=dense_grid_4.Values, SecondNumber=number_slider_32, Tolerance=Slider(1.7, range=0..10))
cull_pattern_4 = CullPattern(List=dense_grid_4.Points, CullPattern=equalst)
center_box_4 = CenterBox(Base=cull_pattern_4, X=division_19, Y=division_19, Z=division_19)
mesh_brep_3 = MeshBrep(
    Brep=center_box_4,
    Settings={GridMaxCount=0, GridMinCount=16, JaggedSeams=False, MaxEdgeLength=0, MinEdgeLength=0.0001, MinTolerance=0, Refine=True, RefineAngle=0, RelativeTolerance=0.65, SimplePlanes=True, Tolerance=0})
mjoin_2 = MeshJoin(Meshes=mesh_brep_3)
list_item_3 = ListItem(List=mesh_brep_3, Index=0, Wrap=True)
add_path_3 = GhPythonScript(
    mola_path="C:\D\GitHub",
    toggle=Toggle(False),
    rhino_mesh=mjoin_2,
    dist_x=Slider(98, range=0..100),
    dist_y=Slider(48, range=0..100))  # -> out, a; inputs rhino_mesh: Mesh, seed: Int32
# ---------- add_path_3: Python ----------
__author__ = "Wen"
__version__ = "2022.10.03"

import sys
import os

if mola_path not in sys.path:
    sys.path.append(mola_path)

# find .py file within the same folder of .gh file
ghComp = ghenv.Component
ghDoc = ghComp.OnPingDocument()
gh_file_location = ghDoc.FilePath

parent = os.path.dirname(os.path.realpath(gh_file_location))
file_name = "20221017_meshsubd_b.py"
file_path = os.path.join(parent, file_name)

# execute .py
if toggle:
    execfile(file_path)
# ---------- end add_path_3 ----------
panel_4 = Panel(add_path_3.out)
geometry_3 = Geometry(add_path_3.a)

# ----
# Outer Shape
number_slider_33 = Slider(25, range=0..100)  # disabled
sph_2 = Sphere(Base=PlaneXY(0, 0, 0), Radius=number_slider_5)  # disabled
popgeo_2 = PopulateGeometry(Geometry=sph_2, Count=number_slider_33, Seed=1)  # disabled
number_slider_34 = Slider(0.2, range=0..1)  # disabled
number_slider_35 = Slider(200, range=0..300)  # disabled
swatch_2 = ColourSwatch(SwatchColor=RGBA(237, 102, 120, 128))  # disabled

plane_3 = Plane(Origin=popgeo_2, Normal=popgeo_2)  # disabled

boolean_intersect_6 = BooleanIntersect(DistanceObjectS=plane_3)  # disabled
shell_4 = Shell(DistanceObject=boolean_intersect_6, Thickness=number_slider_34, Factor=0)  # disabled
isosurface_distancefunction_6 = IsosurfaceDistancefunction(
    BoundingBox=box_4,
    NumberX=number_slider_35,
    NumberY=number_slider_35,
    NumberZ=number_slider_35,
    Isovalue=0,
    Capped=False,
    DistanceObject=shell_4,
    Refine=True)  # disabled
preview_6 = CustomPreview(Geometry=isosurface_distancefunction_6, Material=swatch_2)  # disabled

# ----
# Inner Lattices
number_slider_36 = Slider(0.2, range=0..1)  # disabled
number_slider_37 = Slider(1, range=0..10)  # disabled
number_slider_38 = Slider(200, range=0..300)  # disabled
lattice = Lattice(Cellsize=number_slider_37, Thickness=number_slider_36)  # disabled
boolean_intersect_7 = BooleanIntersect(DistanceObjectS=boolean_intersect_6, DistanceObject=lattice)  # disabled
isosurface_distancefunction_7 = IsosurfaceDistancefunction(
    BoundingBox=box_4,
    NumberX=number_slider_38,
    NumberY=number_slider_38,
    NumberZ=number_slider_38,
    Isovalue=0,
    Capped=False,
    DistanceObject=boolean_intersect_7,
    Refine=True)  # disabled
swatch_3 = ColourSwatch(SwatchColor=RGB(238, 102, 121))  # disabled
preview_7 = CustomPreview(Geometry=isosurface_distancefunction_7, Material=swatch_3)  # disabled
