# Grasshopper definition 20221017_workflow_gyroid.gh (Grasshopper 1.0.7)
# plug-ins: Axolotl Info

number_slider = Slider(300, range=0..1000)
cylinder = Cylinder(Radius=Slider(20, range=0..100), Height=number_slider, Plane=PlaneXY(0, 0, 0), Fillet=0)
cylinder_2 = Cylinder(Radius=Slider(37, range=0..100), Height=number_slider, Plane=PlaneXY(0, 0, 0), Fillet=0)
boolean_subtract = BooleanSubtract(DistanceObject=cylinder_2, DistanceObject_2=cylinder)

# ----
# Inner Lattices
number_slider_2 = Slider(43, range=0..100)
pt = Point(Point(236.8008759, -844.8825538, -143.7845608))
tpms = TPMS(Wavelength=number_slider_2, type=0)
plane = Plane(Origin=pt, Normal="{0, 0, -1}")
shell = Shell(DistanceObject=tpms, Thickness=Slider(0.7, range=0..2), Factor=0.5)
overlay = Overlay(DistanceObject=shell, DistanceObject_2=plane, Factor=Slider(0.003, range=0..0.01))

# ---- group: unit size
number_slider_3 = Slider(4, range=0..10)

# ----
number_slider_4 = Slider(100, range=0..100)
division = Division(A=number_slider_4, B=2)
division_2 = Division(A=number_slider_4, B=2)
division_3 = Division(A=number_slider, B=2)
division_4 = Division(A=number_slider_3, B=2)
number_slider_5 = Slider(100, range=0..100)
division_5 = Division(A=division, B=division_4)
division_6 = Division(A=division_2, B=division_4)
division_7 = Division(A=division_3, B=division_4)
box = CenterBox(Base=PlaneXY(0, 0, 0), X=division, Y=division_2, Z=division_3)

# ---- group: Final Distance Object
boolean_intersect = BooleanIntersect(DistanceObjectS=boolean_subtract, DistanceObject=overlay)

# ----
addition = Addition(A=division_6, B=1)
addition_2 = Addition(A=division_7, B=1)
addition_3 = Addition(A=division_5, B=1)
box_2 = CenterBox(Base=PlaneXY(0, 0, 0), X=number_slider_5, Y=number_slider_5, Z=Slider(200, range=0..1000))

# ----
# Isosurface Meshing
number_slider_6 = Slider(45, range=0..100)
isosurface_distancefunction = IsosurfaceDistancefunction(
    BoundingBox=box_2,
    NumberX=number_slider_6,
    NumberY=number_slider_6,
    NumberZ=number_slider_6,
    Isovalue=0,
    Capped=False,
    DistanceObject=boolean_intersect,
    Refine=True)  # disabled
preview = CustomPreview(Geometry=isosurface_distancefunction, Material=ColourSwatch(SwatchColor=RGB(238, 102, 121)))

dense_grid = DenseGrid(DistanceObject=boolean_intersect, Box=box, NumberX=addition_3, NumberY=addition, NumberZ=addition_2, type=0)  # -> Values, Points
smaller_than = SmallerThan(FirstNumber=dense_grid.Values, SecondNumber=Slider(0, range=0..100))  # -> SmallerThan, OrEqualTo
cull_pattern = CullPattern(List=dense_grid.Points, CullPattern=smaller_than.SmallerThan)
center_box = CenterBox(Base=cull_pattern, X=division_4, Y=division_4, Z=division_4)
mesh_brep = MeshBrep(
    Brep=center_box,
    Settings={GridMaxCount=0, GridMinCount=16, JaggedSeams=False, MaxEdgeLength=0, MinEdgeLength=0.0001, MinTolerance=0, Refine=True, RefineAngle=0, RelativeTolerance=0.65, SimplePlanes=True, Tolerance=0})
mjoin = MeshJoin(Meshes=mesh_brep)
# 1. update mola path
# 2. put both gh and py file in the same folder
add_path = GhPythonScript(
    mola_path="C:\D\GitHub",
    toggle=Toggle(True),
    rhino_mesh=mjoin,
    dist_in=Slider(20.83, range=0..100),
    dist_out=Slider(35, range=0..100))  # -> out, a; inputs rhino_mesh: Mesh, seed: Int32
# ---------- add_path: Python ----------
__author__ = "Wen"
__version__ = "2022.10.03"

import sys
import os

if mola_path not in sys.path:
    sys.path.append(mola_path)

# find .py file within the same folder of .gh file
ghComp = ghenv.Component
ghDoc = ghComp.OnPingDocument()
gh_file_location = ghDoc.FilePath

parent = os.path.dirname(os.path.realpath(gh_file_location))
file_name = "20221017_meshsubd_gyroid.py"
file_path = os.path.join(parent, file_name)

# execute .py
if toggle:
    execfile(file_path)
# ---------- end add_path ----------
panel = Panel(add_path.a)
geometry = Geometry(add_path.a)
