# Grasshopper definition 20221017_workflow_sphereboolean.gh (Grasshopper 1.0.7)
# plug-ins: Axolotl Info

pt = Point(Point(41.74539746, 27.68813706, 19.15644171))
pt_2 = Point(Point(-125.8725825, 102.0043755, 30.94033168))
pt_3 = Point(Point(-54.94556724, -27.90342454, 18.099235))
box = Box(
    DimensionX=Slider(200, range=0..1000),
    DimensionY=Slider(100, range=0..100),
    DimensionZ=Slider(100, range=0..100),
    Radius=0,
    Plane=PlaneXY(0, 0, 0))
sphere = Sphere(Radius=Slider(80, range=0..100), Center=pt)
sphere_2 = Sphere(Radius=Slider(60, range=0..100), Center=pt_3)
sphere_3 = Sphere(Radius=Slider(100, range=0..100), Center=pt_2)
boolean_union = BooleanUnion(DistanceObjectS=sphere, DistanceObject=sphere_2)
boolean_union_2 = BooleanUnion(DistanceObjectS=boolean_union, DistanceObject=sphere_3)

# ---- group: unit size
number_slider = Slider(4, range=0..10)

# ---- group: cut the top with bounding box
neg = Negative(Value=Slider(10, range=0..10))
pt_4 = ConstructPoint(XCoordinate=0, YCoordinate=0, ZCoordinate=neg)

# ----
number_slider_2 = Slider(220, range=0..300)
pt_5 = Point(<point referenced from the Rhino model>)
division = Division(A=Slider(200, range=0..1000), B=2)
division_2 = Division(A=Slider(100, range=0..100), B=2)
division_3 = Division(A=Slider(100, range=0..100), B=2)
division_4 = Division(A=number_slider, B=2)

# ---- group: Final Distance Object
boolean_subtract = BooleanSubtract(DistanceObject=box, DistanceObject_2=boolean_union_2)

# ----
division_5 = Division(A=division_3, B=division_4)
division_6 = Division(A=division, B=division_4)
division_7 = Division(A=division_2, B=division_4)
box_2 = CenterBox(Base=pt_5, X=number_slider_2, Y=number_slider_2, Z=Slider(100, range=0..1000))
box_3 = CenterBox(Base=pt_4, X=division, Y=division_2, Z=division_3)
addition = Addition(A=division_6, B=1)
addition_2 = Addition(A=division_7, B=1)
addition_3 = Addition(A=division_5, B=1)
dense_grid = DenseGrid(DistanceObject=boolean_subtract, Box=box_3, NumberX=addition, NumberY=addition_2, NumberZ=addition_3, type=0)  # -> Values, Points

# ----
# Isosurface Meshing
number_slider_3 = Slider(80, range=0..100)
isosurface_distancefunction = IsosurfaceDistancefunction(
    BoundingBox=box_2,
    NumberX=number_slider_3,
    NumberY=number_slider_3,
    NumberZ=number_slider_3,
    Isovalue=0,
    Capped=False,
    DistanceObject=boolean_subtract,
    Refine=True)  # disabled
preview = CustomPreview(Geometry=isosurface_distancefunction, Material=ColourSwatch(SwatchColor=RGB(238, 102, 121)))

absolute = Absolute(Value=dense_grid.Values)
smaller_than = SmallerThan(FirstNumber=absolute, SecondNumber=Slider(2, range=0..10))  # -> SmallerThan, OrEqualTo
cull_pattern = CullPattern(List=dense_grid.Points, CullPattern=smaller_than.SmallerThan)
center_box = CenterBox(Base=cull_pattern, X=division_4, Y=division_4, Z=division_4)
mesh_brep = MeshBrep(
    Brep=center_box,
    Settings={GridMaxCount=0, GridMinCount=16, JaggedSeams=False, MaxEdgeLength=0, MinEdgeLength=0.0001, MinTolerance=0, Refine=True, RefineAngle=0, RelativeTolerance=0.65, SimplePlanes=True, Tolerance=0})
mjoin = MeshJoin(Meshes=mesh_brep)
# 1. update mola path
# 2. put both gh and py file in the same folder
add_path = GhPythonScript(
    mola_path="C:\D\GitHub",
    toggle=Toggle(True),
    rhino_mesh=mjoin,
    dist_x=Slider(98, range=0..100),
    dist_y=Slider(48, range=0..100))  # -> out, a; inputs rhino_mesh: Mesh, seed: Int32
# ---------- add_path: Python ----------
__author__ = "Wen"
__version__ = "2022.10.03"

import sys
import os

if mola_path not in sys.path:
    sys.path.append(mola_path)

# find .py file within the same folder of .gh file
ghComp = ghenv.Component
ghDoc = ghComp.OnPingDocument()
gh_file_location = ghDoc.FilePath

parent = os.path.dirname(os.path.realpath(gh_file_location))
file_name = "20221017_meshsubd_sphereboolean.py"
file_path = os.path.join(parent, file_name)

# execute .py
if toggle:
    execfile(file_path)
# ---------- end add_path ----------
panel = Panel(add_path.a)
geometry = Geometry(add_path.a)
