# Grasshopper definition 220928_random_walker.gh (Grasshopper 1.0.7)
# plug-ins: Bifocals

python = GhPythonScript(count=Slider(5, range=0..10), time=Slider(100, range=0..100), size=Slider(3, range=0..10))  # -> out, points, boxes; inputs count: Int32, time: Int32
# ---------- python: Python ----------
__author__ = "Wen"
__version__ = "2022.09.28"

import Rhino.Geometry as rg
import random
from System.Drawing import Color

class Walker():
    "https://en.wikipedia.org/wiki/Random_walk"
    def __init__(self, x, y, z, size, color):
        self.x = x
        self.y = y
        self.z = z
        self.size = size
        self.color = color
        self.pts = []
        
    def move_cartesian(self):
        choice = random.randint(0, 5)
        if choice == 0:
            self.x += self.size
        elif choice == 1:
            self.y += self.size
        elif choice == 2:
            self.z += self.size
        elif choice == 3:
            self.x -= self.size
        elif choice == 4:
            self.y -= self.size
        else:
            self.z -= self.size
        self._update_path()
        
    def _update_path(self):
        pt = rg.Point3d(self.x, self.y, self.z)
        self.pts.append(pt)
        
    def draw_boxes(self):
        boxes = []
        for pt in self.pts:
            dom = rg.Interval(-self.size/2, self.size/2)
            box = rg.Box(rg.Plane(pt, rg.Vector3d.ZAxis), dom, dom, dom)
            box_mesh = rg.Mesh.CreateFromBox(box, 1, 1, 1)
            box_mesh.VertexColors.CreateMonotoneMesh(self.color)
            boxes.append(box_mesh)
        return boxes


walkers = []
for _ in range(count):
    walker = Walker(0, 0, 0, size, Color.FromArgb(255, random.randint(0, 255), 0, random.randint(0, 255)))
    walkers.append(walker)
    
for t in range(time):
    for walker in walkers:
        walker.move_cartesian()
        
points = []
boxes = []
for walker in walkers:
    points.append(walker.pts)
    boxes.append(walker.draw_boxes())
# ---------- end python ----------
ghpython_script = GhPythonScript(x=python.boxes)  # -> out, a
# ---------- ghpython_script: Python ----------
a=x
# ---------- end ghpython_script ----------
# Ideas for additional practice
# 
# 
# . Generate boundaries to contain the walkers
# 
# . Base the pixels color on their spatial locations
# 
# . Add a 'bias' in the random walking that steers the walker in a certain direction
# 
# . Add diagonal (or other creative) steps
ghpython_script_2 = GhPythonScript(x=python.points)  # -> out, a; same code as ghpython_script
mesh = Mesh(ghpython_script.a)
lng = ListLength(List=ghpython_script.a)
series = Series(Start=0, Step=1, Count=lng)
medges = MeshEdges(Mesh=mesh)  # -> NakedEdges, InteriorEdges, NonManifoldEdges
gradient = Gradient(
    LowerLimit=0,
    UpperLimit=lng,
    Parameter=series,
    stops=[0: RGB(0, 98, 0), 0.25: RGB(81, 175, 17), 0.5: RGB(159, 198, 146), 0.75: RGB(170, 235, 41), 1: RGB(221, 255, 53)])
cloud = CloudDisplay(Points=ghpython_script_2.a, Colours=gradient, Size=1, SpriteType=0)
