# Grasshopper definition 220928_simulation_walker.gh (Grasshopper 1.0.7)
# plug-ins: Bifocals

number_slider = Slider(50, range=0..100)
# --- Ideas for simpler tasks ---
# .Experiment with different forces. Ex: implement gravity force (i.e. a force that points downwards; in the negative z direction)
# .Constrain the bouncies in a sphere instead of a rectangle
# 
# 
# --- A bit more advanced tasks ---
# .Give to the bouncies a cooler body shape that is oriented in the direction of the motion (i.e. the velocity vector).
# .Find a creative way to display the trajectories of the bouncies. With colors maybe?
# 
# 
# --- Very advanced task ---
# .Implement collisions between spheres
# Hints: This requires a nested for-loop.
# The task can be split in two steps: 1) detect collisions
# 2) change velocities of colliding spheres
negative = Negative(Value=number_slider)
vector_xyz = VectorXYZ(XComponent=0, YComponent="1", ZComponent=0)  # -> Vector, Length
construct_domain = ConstructDomain(DomainStart=negative, DomainEnd=number_slider)
division = Division(A=vector_xyz.Vector, B=Slider(82, range=0..100))
domain_box = DomainBox(Base=PlaneXY(0, 0, 0), X=construct_domain, Y=construct_domain, Z=construct_domain)
ghpython_script = GhPythonScript(count=Slider(5, range=0..10), boundary=number_slider, time=Slider(151, range=0..1000), force=division)  # -> out, trajectories, spheres; inputs count: Int32, time: Int32, force: Vector3d
# ---------- ghpython_script: Python ----------
__author__ = "Wen"
__version__ = "2022.09.28"

import Rhino.Geometry as rg
import random

class Bouncy():
    
    def __init__(self, p, v, a):
        self.p = p
        self.v = v
        self.a = a
        
        self.pts = [self.p]
    
    def move(self, bound):
        
        self.v += self.a 
        next_p = self.p + self.v  # check the potential next move, if it is out of bound
        
        if abs(next_p.X) >= bound:
            self.v.X *= -1
        if abs(next_p.Y) >= bound:
            self.v.Y *= -1
        if abs(next_p.Z) >= bound:
            self.v.Z *= -1
        
        self.p += self.v
        self.pts.append(self.p)

    def draw_path(self):
        if len(self.pts) >= 2:
            return rg.Curve.CreateInterpolatedCurve(self.pts, 1)
        else:
            return 
    
    def draw_sphere(self):
        return rg.Sphere(self.p, 3) 
    
    def reverse(self):
        # exercise
        pass

random.seed(0)

bouncies = []
for _ in range(count):
    bouncy = Bouncy(rg.Point3d(0, 0, 0), rg.Vector3d(random.uniform(-1, 1),
    random.uniform(-1, 1), random.uniform(-1, 1)), force)
    bouncies.append(bouncy)

for _ in range(time):
    for bouncy in bouncies:
        bouncy.move(boundary)
        
    # exercise part
    # if they bounce to each other
    for i in range(len(bouncies)):
        for j in range(len(bouncies))[i+1:]:
            #print(i, " ", j)
            dist = bouncies[i].p.DistanceTo(bouncies[j].p)
            if dist <= 6:
                bouncies[i].reverse()
                bouncies[j].reverse()


trajectories = []
spheres = []
for bouncy in bouncies:
    trajectories.append(bouncy.draw_path())
    spheres.append(bouncy.draw_sphere())
# ---------- end ghpython_script ----------
brep_edges = BrepEdges(Brep=domain_box)  # -> Naked, Interior, NonManifold
